# Dynamo custom node Analysis Period.dyf (Dynamo 0.9.1.3360)
# category: Ladybug.1|Analyze Weather Data
# Create a Ladybug Analysis Period

# group: load the script
code_block = CodeBlock { "analysisPeriod_node.py"; }
find_file_and_import_it = Python(IN[0]=code_block)
# ---------- find_file_and_import_it.python (16 lines) ----------
def getPackagePath(packageName):
	import sys
	sys.path.append('C:\Program Files (x86)\IronPython 2.7\Lib')
	import os
	import clr
	clr.AddReference('DynamoCore')
	dynamoPath = clr.References[2].Location.split('\\')[2].replace(' ', '\\')
	appdata = os.getenv('APPDATA')
	return '%s\%s\packages\%s\extra\\'%(appdata, dynamoPath, packageName)

filePath = getPackagePath('Ladybug') + IN[0]

with open(filePath, 'rb') as inf:
    lines = inf.readlines()

OUT = ''.join(lines)
# ----------------------------------------

startMonth = Input(_startMonth_: int = 1)  # Start month (1-12)
startDay = Input(_startDay_: int = 1)  # Start day (1-31)
startHour = Input(_startHour_: int = 1)  # Start hour (1-24)
endMonth = Input(_endMonth_: int = 12)  # End month (1-12)
endDay = Input(_endDay_: int = 31)  # End day (1-31)
endHour = Input(_endHour_: int = 24)  # End hour (1-24)
timestep = Input(_timestep_: int = 1)  # An integer number from 1, 2, 3, 4, 5, 6, 10, 12, 15, 20, 30, 60
python_script_from_string = PythonStringNode(script=find_file_and_import_it, IN[0]=startMonth, IN[1]=startDay, IN[2]=startHour, IN[3]=endMonth, IN[4]=endDay, IN[5]=endHour, IN[6]=timestep)
code_block_2 = CodeBlock(out=python_script_from_string) { out[0]; out[1]; out[2]; }
analysisPeriod = Output(code_block_2.out0)
dates = Output(code_block_2.out1)
hoursOfYear = Output(code_block_2.out2)
