# Dynamo custom node Calculate HOY.dyf (Dynamo 0.9.1.3872)
# category: Ladybug.1|Analyze Weather Data
# Calculate hour of year for a month, day and hour

# group: load the script
code_block = CodeBlock { "calculateHOY_node.py"; }
find_file_and_import_it = Python(IN[0]=code_block)
# ---------- find_file_and_import_it.python (21 lines) ----------
try:
	def getPackagePath(packageName):
		import sys
		sys.path.append('C:\Program Files (x86)\IronPython 2.7\Lib')
		import os
		import clr
		clr.AddReference('DynamoCore')
		dynamoPath = clr.References[2].Location.split('\\')[2].replace(' ', '\\')
		appdata = os.getenv('APPDATA')
		return '%s\%s\packages\%s\extra\\'%(appdata, dynamoPath, packageName)
	
	filePath = getPackagePath('Ladybug') + IN[0]
	
	with open(filePath, 'rb') as inf:
	    lines = inf.readlines()
	
	OUT = ''.join(lines)
except Exception, e:
	OUT = "ERROR: %s"%str(e) + \
		"\n\nIf you think this is a bug submit an issue on github.\n" + \
		"https://github.com/ladybug-analysis-tools/ladybug-dynamo/issues"
# ----------------------------------------

month = Input(_month_: int = 12)  # A number between 1 and 12 that represents the month of the year
day = Input(_day_: int = 21)  # A number between 1 and 31 that represents the day of the month
hour = Input(_hour_: double = 12.0)  # A number between 1 and 24 that represents the hour of the day
minute = Input(_minute_: int = 0)  # A number between 0 and 59 that represents the minute of the hour
python_script_from_string = PythonStringNode(script=find_file_and_import_it, IN[0]=month, IN[1]=day, IN[2]=hour, IN[3]=minute)
code_block_2 = CodeBlock(out=python_script_from_string) { out[0]; out[1]; out[2]; }
HOY = Output(code_block_2.out0)
DOY = Output(code_block_2.out1)
datetime = Output(code_block_2.out2)
error_report = Python(IN[0]=find_file_and_import_it, IN[1]=python_script_from_string)
# ---------- error_report.python (15 lines) ----------
"""Report errors"""
importErr = IN[0]
runErr = IN[1]
errors = []

if importErr and str(importErr).startswith("ERROR:"):
	errors.append(importErr)

if runErr and str(runErr).startswith("ERROR:"):
	errors.append(runErr)

if len(errors)==0:
	OUT = "All good! Vvizzzz."
else:
	OUT = "\n".join(errors)
# ----------------------------------------
ERRReport = Output(error_report)
