# Dynamo custom node Color Surface.dyf (Dynamo 0.9.1.3872)
# category: Ladybug.4|Extra
# Color a test surface based on the results of a study. The results structure should match the test points structure to be mapped correctly on the surface.

analysisSurfaces = Input(_analysisSurfaces: var[])  # A list of analysis surfaces

# group: load the script
code_block = CodeBlock { "colorSurface_node.py"; }
find_file_and_import_it = Python(IN[0]=code_block)
# ---------- find_file_and_import_it.python (16 lines) ----------
def getPackagePath(packageName):
	import sys
	sys.path.append('C:\Program Files (x86)\IronPython 2.7\Lib')
	import os
	import clr
	clr.AddReference('DynamoCore')
	dynamoPath = clr.References[2].Location.split('\\')[2].replace(' ', '\\')
	appdata = os.getenv('APPDATA')
	return '%s\%s\packages\%s\extra\\'%(appdata, dynamoPath, packageName)

filePath = getPackagePath('Ladybug') + IN[0]

with open(filePath, 'rb') as inf:
    lines = inf.readlines()

OUT = ''.join(lines)
# ----------------------------------------

values = Input()  # "_values"
legendPar = Input(_legendPar_: var = 0)  # Ladybug legend parameters
python_script_from_string = PythonStringNode(script=find_file_and_import_it, IN[0]=analysisSurfaces, IN[1]=values, IN[2]=legendPar)
bySurfaceColors = Display.Display.BySurfaceColors(analysisSurfaces, python_script_from_string)
Display = Output(bySurfaceColors)
