# Dynamo custom node Generate Test Points.dyf (Dynamo 0.9.1.3872)
# category: Ladybug.4|Extra
# Generate test points from a surface based on number of segments and distance from the surface

# group: load the script
code_block = CodeBlock { "genTestPts_node.py"; }

find_file_and_import_it = Python(IN[0]=code_block)
# ---------- find_file_and_import_it.python (21 lines) ----------
try:
	def getPackagePath(packageName):
		import sys
		sys.path.append('C:\Program Files (x86)\IronPython 2.7\Lib')
		import os
		import clr
		clr.AddReference('DynamoCore')
		dynamoPath = clr.References[2].Location.split('\\')[2].replace(' ', '\\')
		appdata = os.getenv('APPDATA')
		return '%s\%s\packages\%s\extra\\'%(appdata, dynamoPath, packageName)
	
	filePath = getPackagePath('Ladybug') + IN[0]
	
	with open(filePath, 'rb') as inf:
	    lines = inf.readlines()
	
	OUT = ''.join(lines)
except Exception, e:
	OUT = "ERROR: %s"%str(e) + \
		"\n\nIf you think this is a bug submit an issue on github.\n" + \
		"https://github.com/ladybug-analysis-tools/ladybug-dynamo/issues"
# ----------------------------------------
testSurfaces = Input(_testSurfaces: var[]..[])  # A list or a single test surface
numOfSegments = Input(_numOfSegments_: int = 10)  # Number of divisions in U and V directions. Default is set to 10
disFromSurface = Input(_disFromSurface_: double = 0.01)  # Test point distance from base surface. Default is set to 0.01
python_script_from_string = PythonStringNode(script=find_file_and_import_it, IN[0]=testSurfaces, IN[1]=numOfSegments, IN[2]=disFromSurface)
code_block_2 = CodeBlock(out=python_script_from_string) { out[0]; out[1]; }
testPts = Output(code_block_2.out0)
ptsNormal = Output(code_block_2.out1)
error_report = Python(IN[0]=find_file_and_import_it, IN[1]=python_script_from_string)
# ---------- error_report.python (15 lines) ----------
"""Report errors"""
importErr = IN[0]
runErr = IN[1]
errors = []

if importErr and str(importErr).startswith("ERROR:"):
	errors.append(importErr)

if runErr and str(runErr).startswith("ERROR:"):
	errors.append(runErr)

if len(errors)==0:
	OUT = "All good! Vvizzzz."
else:
	OUT = "\n".join(errors)
# ----------------------------------------
ERRReport = Output(error_report)
