# Dynamo custom node Import Location.dyf (Dynamo 0.9.1.3872)
# category: Ladybug.0|Ladybug
# Import location data from an epw weather file

# group: load the script
code_block = CodeBlock { "importLocation_node.py"; }
find_file_and_import_it = Python(IN[0]=code_block)
# ---------- find_file_and_import_it.python (16 lines) ----------
def getPackagePath(packageName):
	import sys
	sys.path.append('C:\Program Files (x86)\IronPython 2.7\Lib')
	import os
	import clr
	clr.AddReference('DynamoCore')
	dynamoPath = clr.References[2].Location.split('\\')[2].replace(' ', '\\')
	appdata = os.getenv('APPDATA')
	return '%s\%s\packages\%s\extra\\'%(appdata, dynamoPath, packageName)

filePath = getPackagePath('Ladybug') + IN[0]

with open(filePath, 'rb') as inf:
    lines = inf.readlines()

OUT = ''.join(lines)
# ----------------------------------------

epwFile = Input(_epwFile: string)  # File path to a valid epw file
python_script_from_string = PythonStringNode(script=find_file_and_import_it, IN[0]=epwFile)
location = Output(python_script_from_string)
