# Dynamo custom node Import epw.dyf (Dynamo 1.0.0.1180)
# category: Ladybug.0|Ladybug
# Use this node to import lists of weather data into Dynamo from a standard .epw file.
# For detailed information about the structure of an epw file, you may want to read the
# "Weather Converter Program" section in "Auxiliary EnergyPlus Programs" document.
# All descriptions of importaed data are borrowed from this document.
# The document is available online at this address:
# "http://apps1.eere.energy.gov/buildings/energyplus/pdfs/auxiliaryprograms.pdf"

# group: load the script
code_block = CodeBlock { "importEPW_node.py"; }

find_file_and_import_it = Python(IN[0]=code_block)
# ---------- find_file_and_import_it.python (34 lines) ----------
try:
	def getPackagePath(packageName):
		import sys
		sys.path.append('C:\Program Files (x86)\IronPython 2.7\Lib')
		import os
		import clr
		clr.AddReference('DynamoCore')
		_loc = clr.References[2].Location
		_ver = _loc.split('\\')[-2].split(' ')[-1]
		
		# the path structure has changed after the release of version 1
		dynamoPath_1 = "Dynamo\\Dynamo Revit\\" + _ver
		dynamoPath_0 = "Dynamo\\" + _ver
		appdata = os.getenv('APPDATA')
		path1 = '%s\%s\packages\%s\extra\\'%(appdata, dynamoPath_1, packageName)
		path0 = '%s\%s\packages\%s\extra\\'%(appdata, dynamoPath_0, packageName)
		
		if os.path.isdir(path1):
			return path1
		elif os.path.isdir(path0):
			return path0
		else:
			raise Exception("Can't find Dynamo installation Folder!")

	filePath = getPackagePath('Ladybug') + IN[0]

	with open(filePath, 'rb') as inf:
	    lines = inf.readlines()

	OUT = ''.join(lines)
except Exception, e:
	OUT = "ERROR: %s"%str(e) + \
		"\n\nIf you think this is a bug submit an issue on github.\n" + \
		"https://github.com/ladybug-analysis-tools/ladybug-dynamo/issues"
# ----------------------------------------
epwFile = Input(_epwFile: string)  # File path to a valid epw file
analysisPeriod = Input(_analysisPeriod_: string = "1/1 to 12/31 between 1 to 24 @1")  # Ladybug Analysis Period
python_script_from_string = PythonStringNode(script=find_file_and_import_it, IN[0]=epwFile, IN[1]=analysisPeriod)
separate_outputs = CodeBlock(out=python_script_from_string)
# ---------- separate_outputs.designscript (16 lines) ----------
out[0];
out[1];
out[2];
out[3];
out[4];
out[5];
out[6];
out[7];
out[8];
out[9];
out[10];
out[11];
out[12];
out[13];
out[14];
out[15];
# ----------------------------------------
location = Output(separate_outputs.out0)
dryBulbTemperature = Output(separate_outputs.out1)
dewPointTemperature = Output(separate_outputs.out2)
relativeHumidity = Output(separate_outputs.out3)
windDirection = Output(separate_outputs.out4)
windSpeed = Output(separate_outputs.out5)
directNormalRadiation = Output(separate_outputs.out6)
diffuseHorizontalRadiation = Output(separate_outputs.out7)
globalHorizontalRadiation = Output(separate_outputs.out8)
directNormalIlluminance = Output(separate_outputs.out9)
diffuseHorizontalIlluminance = Output(separate_outputs.out10)
globalHorizontalIlluminance = Output(separate_outputs.out11)
liquidPrecipitationDepth = Output(separate_outputs.out13)
totalSkyCover = Output(separate_outputs.out12)
barometricPressure = Output(separate_outputs.out14)
modelYear = Output(separate_outputs.out15)
error_report = Python(IN[0]=find_file_and_import_it, IN[1]=python_script_from_string)
# ---------- error_report.python (15 lines) ----------
"""Report errors"""
importErr = IN[0]
runErr = IN[1]
errors = []

if importErr and str(importErr).startswith("ERROR:"):
	errors.append(importErr)

if runErr and str(runErr).startswith("ERROR:"):
	errors.append(runErr)

if len(errors)==0:
	OUT = "All good! Vvizzzz."
else:
	OUT = "\n".join(errors)
# ----------------------------------------
ERRReport = Output(error_report)
