# Dynamo custom node LB Color Range.dyf (Dynamo 0.9.1.3872)
# category: Ladybug.4|Extra
# A set of color ranges for coloring analysis results

# group: load the script
code_block = CodeBlock { "colorRange_node.py"; }

find_file_and_import_it = Python(IN[0]=code_block)
# ---------- find_file_and_import_it.python (21 lines) ----------
try:
	def getPackagePath(packageName):
		import sys
		sys.path.append('C:\Program Files (x86)\IronPython 2.7\Lib')
		import os
		import clr
		clr.AddReference('DynamoCore')
		dynamoPath = clr.References[2].Location.split('\\')[2].replace(' ', '\\')
		appdata = os.getenv('APPDATA')
		return '%s\%s\packages\%s\extra\\'%(appdata, dynamoPath, packageName)
	
	filePath = getPackagePath('Ladybug') + IN[0]
	
	with open(filePath, 'rb') as inf:
	    lines = inf.readlines()
	
	OUT = ''.join(lines)
except Exception, e:
	OUT = "ERROR: %s"%str(e) + \
		"\n\nIf you think this is a bug submit an issue on github.\n" + \
		"https://github.com/ladybug-analysis-tools/ladybug-dynamo/issues"
# ----------------------------------------
index = Input(_index_: double = 1)  # An index between 0-21 refering to one of the following possible gradients 0 - Orignal Ladybug 1 - Nuanced Ladybug 2 - Multi-colored Ladybug 3 - View Analysis 1 4 - View Analysis 2 (Red,Green,Blue) 5 - Sunlight Hours 6 - Ecotect 7 - Thermal Comfort Percentage 8 - Thermal Comfort Colors 9 - Thermal Comfort Colors (UTCI) 10 - Hot Hours 11 - Cold Hours 12 - Shade Benefit/Harm 13 - Thermal Comfort Colors v2 (UTCI) 14 - Shade Harm 15 - Shade Benefit 16 - Black to White 17 - CFD Colors 1 18 - CFD Colors 2 19 - Energy Balance 20 - THERM 21 - Cloud Cover
python_script_from_string = PythonStringNode(script=find_file_and_import_it, IN[0]=index)
colors = Output(python_script_from_string)
error_report = Python(IN[0]=find_file_and_import_it, IN[1]=python_script_from_string)
# ---------- error_report.python (15 lines) ----------
"""Report errors"""
importErr = IN[0]
runErr = IN[1]
errors = []

if importErr and str(importErr).startswith("ERROR:"):
	errors.append(importErr)

if runErr and str(runErr).startswith("ERROR:"):
	errors.append(runErr)

if len(errors)==0:
	OUT = "All good! Vvizzzz."
else:
	OUT = "\n".join(errors)
# ----------------------------------------
ERRReport = Output(error_report)
