# Dynamo custom node Legend Parameters.dyf (Dynamo 0.9.1.3872)
# category: Ladybug.4|Extra
# Use legend parameter to set up results visualization setting

# group: load the script
code_block = CodeBlock { "legendParameters_node.py"; }

find_file_and_import_it = Python(IN[0]=code_block)
# ---------- find_file_and_import_it.python (21 lines) ----------
try:
	def getPackagePath(packageName):
		import sys
		sys.path.append('C:\Program Files (x86)\IronPython 2.7\Lib')
		import os
		import clr
		clr.AddReference('DynamoCore')
		dynamoPath = clr.References[2].Location.split('\\')[2].replace(' ', '\\')
		appdata = os.getenv('APPDATA')
		return '%s\%s\packages\%s\extra\\'%(appdata, dynamoPath, packageName)
	
	filePath = getPackagePath('Ladybug') + IN[0]
	
	with open(filePath, 'rb') as inf:
	    lines = inf.readlines()
	
	OUT = ''.join(lines)
except Exception, e:
	OUT = "ERROR: %s"%str(e) + \
		"\n\nIf you think this is a bug submit an issue on github.\n" + \
		"https://github.com/ladybug-analysis-tools/ladybug-dynamo/issues"
# ----------------------------------------
cType = Input(_cType_: int = 0)  # 0> continuous, 1> segmented, 2> ordinal. Default 0
domain = Input(_domain_: var[] = {})  # A list of numbers or strings. For numerical values it should be sorted from min to max. Default> ['min', 'max']
colors = Input(_colors_: var[] = {})  # An optional list of colors. Default is nuanced Ladybug colors.
python_script_from_string = PythonStringNode(script=find_file_and_import_it, IN[0]=cType, IN[1]=domain, IN[2]=colors)
legendPar = Output(python_script_from_string)
error_report = Python(IN[0]=find_file_and_import_it, IN[1]=python_script_from_string)
# ---------- error_report.python (15 lines) ----------
"""Report errors"""
importErr = IN[0]
runErr = IN[1]
errors = []

if importErr and str(importErr).startswith("ERROR:"):
	errors.append(importErr)

if runErr and str(runErr).startswith("ERROR:"):
	errors.append(runErr)

if len(errors)==0:
	OUT = "All good! Vvizzzz."
else:
	OUT = "\n".join(errors)
# ----------------------------------------
ERRReport = Output(error_report)
