# Dynamo custom node Sunlighthours Analysis.dyf (Dynamo 0.9.1.3872)
# category: Ladybug.3|Environmental Analysis
# Calculate sunlight hours for a list of test points

# group: load the script
code_block = CodeBlock { "sunlighthours_node.py"; }
find_file_and_import_it = Python(IN[0]=code_block)
# ---------- find_file_and_import_it.python (16 lines) ----------
def getPackagePath(packageName):
	import sys
	sys.path.append('C:\Program Files (x86)\IronPython 2.7\Lib')
	import os
	import clr
	clr.AddReference('DynamoCore')
	dynamoPath = clr.References[2].Location.split('\\')[2].replace(' ', '\\')
	appdata = os.getenv('APPDATA')
	return '%s\%s\packages\%s\extra\\'%(appdata, dynamoPath, packageName)

filePath = getPackagePath('Ladybug') + IN[0]

with open(filePath, 'rb') as inf:
    lines = inf.readlines()

OUT = ''.join(lines)
# ----------------------------------------

testPoints = Input(_testPoints: var[]..[])  # Test points. You can use several methods including using Generate Test Points to generate test points.
geometries = Input(_geometries: var[]..[])  # All the context geometries as surfaces
sunVectors = Input()  # "_sunVectors"
python_script_from_string = PythonStringNode(script=find_file_and_import_it, IN[0]=testPoints, IN[1]=geometries, IN[2]=sunVectors)
sunlightHours = Output(python_script_from_string)
