# Dynamo graph sunlighthoursAnalysis.dyn (Dynamo 1.0.0.193)

XY = Plane.XY()
code_block = CodeBlock { 100; }
byWidthLength = Rectangle.ByWidthLength(plane=XY, width=code_block, length=code_block)
byPatch = Surface.ByPatch(byWidthLength)

# group: load the script
code_block_2 = CodeBlock { "sunlighthours_node.py"; }
find_file_and_import_it = Python(IN[0]=code_block_2)
# ---------- find_file_and_import_it.python (16 lines) ----------
def getPackagePath(packageName):
	import sys
	sys.path.append('C:\Program Files (x86)\IronPython 2.7\Lib')
	import os
	import clr
	clr.AddReference('DynamoCore')
	dynamoPath = clr.References[2].Location.split('\\')[2].replace(' ', '\\')
	appdata = os.getenv('APPDATA')
	return '%s\%s\packages\%s\extra\\'%(appdata, dynamoPath, packageName)

filePath = getPackagePath('Ladybug') + IN[0]

with open(filePath, 'rb') as inf:
    lines = inf.readlines()

OUT = ''.join(lines)
# ----------------------------------------

number_of_segments = CodeBlock { 14; }
distance_from_base = CodeBlock { 0.1; }
generate_test_points = Custom[Generate Test Points](testSurfaces=byPatch, numOfSegments=number_of_segments, disFromSurface=distance_from_base)  # Generate test points from a surface based on number of segments and distance from the surface
byCoordinates = Point.ByCoordinates()
YAxis = Vector.YAxis()
code_block_3 = CodeBlock { 45; }
rotate = Geometry.Rotate(geometry=byWidthLength, origin=byCoordinates, axis=YAxis, degrees=code_block_3)
byPatch_2 = Surface.ByPatch(rotate)
code_block_4 = CodeBlock { 0.5; }
scale = Geometry.Scale(geometry=byPatch_2, xamount=code_block_4, yamount=code_block_4, zamount=code_block_4)
create = List.Create(byPatch, scale)
file_path = Filename("C:\EnergyPlusV8-3-0\WeatherData\USA_CA_San.Francisco.Intl.AP.724940_TMY3.epw")
import_location = Custom[Import Location](epwFile=file_path)  # Import location data from an epw weather file
code_block_5 = CodeBlock { 6; }
code_block_6 = CodeBlock { 7..20; }
calculate_hoy = Custom[Calculate HOY](month=code_block_5, hour=code_block_6)  # Calculate hour of year for a month, day and hour
sunpath = Custom[Sunpath](location=import_location, hoursOfYear=calculate_hoy.HOY)  # Use this node to make a 3D sun-path (aka. sun plot) in the Dynamo scene. The node also outputs sun vectors that can be used for sunlight hours analysis or shading design with the other Ladybug nodes.
python_script_from_string = PythonStringNode(script=find_file_and_import_it, IN[0]=generate_test_points.testPts, IN[1]=create, IN[2]=sunpath.sunVectors)
color_surface = Custom[Color Surface](analysisSurfaces=byPatch, values=python_script_from_string)  # Color a test surface based on the results of a study. The results structure should match the test points structure to be mapped correctly on the surface.
